# Grasshopper definition parade_parametrizada.gh (Grasshopper 1.0.7)

# ref.:
# 
# https://www.youtube.com/watch?v=stYu0Kfe3Ps
surface = Surface(<surface referenced from the Rhino model>)
number_slider = Slider(6, range=0..10)
unit_z = UnitZ(Factor=1)
contour = Contour(Shape=surface, Point=Point(0, 0, 0), Direction=unit_z, Distance=number_slider)  # -> flatten(Contours)
domain_box = DomainBox(Base=PlaneXY(0, 0, 0), X=Slider(20, range=0..100), Y=Slider(10, range=0..10), Z=number_slider)
deconstruct_brep = DeconstructBrep(Brep=domain_box)  # -> Faces, Edges, Vertices
dispatch = Dispatch(List=contour, DispatchPattern=[True, False])  # -> ListA, ListB
number_slider_2 = Slider(33, range=0..100)
curve = Curve(dispatch.ListA)
curve_2 = Curve(dispatch.ListB)
list_item = ListItem(List=deconstruct_brep.Faces, Index=Slider(4, range=0..10), Wrap=True)
horizontal_frames = HorizontalFrames(Curve=curve, Count=number_slider_2)  # -> Frames, Parameters
horizontal_frames_2 = HorizontalFrames(Curve=curve_2, Count=number_slider_2)  # -> Frames, Parameters
area = Area(Geometry=list_item)  # -> Area, Centroid
point = Point(area.Centroid)
dispatch_2 = Dispatch(List=horizontal_frames.Frames, DispatchPattern=[True, False])  # -> ListA, ListB
dispatch_3 = Dispatch(List=horizontal_frames_2.Frames, DispatchPattern=[True, False])  # -> ListA, ListB
plane = Plane(dispatch_2.ListA)
plane_2 = Plane(dispatch_3.ListB)
orient = Orient(Geometry=domain_box, Source=point, Target=plane)  # -> Geometry, Transform
orient_2 = Orient(Geometry=domain_box, Source=point, Target=plane_2)  # -> Geometry, Transform
